# Grasshopper definition SPACE.gh (Grasshopper 1.0.8)

panel = Panel("SPACE V2")

brep = Brep(<brep referenced from the Rhino model>)

random_seed = Slider(72, range=0..100)
_3d_lattice_generation = Python3Script(
    bounding_geometry=brep,
    margin=Slider(5, range=0..10),
    resolution=Slider(64, range=0..100),
    count=Slider(50, range=0..100),
    radius=Slider(1, range=0.01..2),
    seed=random_seed)  # -> out, Geometry; inputs bounding_geometry: Brep, margin: Int32, resolution: Int32, count: Int32; disabled
# ---------- _3d_lattice_generation: Python ----------
# Code adapted from https://sdritsas.github.io/ddf/geometry/solids/voxels/#voxel-grid

import random
from Rhino.Geometry import Curve, Point3d, BoundingBox, Mesh

random.seed(seed)

class VoxelGrid:
    def __init__( self, minimum, maximum, resolution ):
        self.Min    = minimum
        self.Max    = maximum
        self.Count  = resolution
        self.Reset( )

    def Reset( self ):
        nx, ny, nz = self.Count
        self.Values = [[[0.0
            for iz in range( nz )]
                for iy in range( ny )]
                    for ix in range( nx )]

    def PointIndices( self ):
        nx, ny, nz = self.Count
        for ix in range( nx ):
            for iy in range( ny ):
                for iz in range( nz ):
                    yield ( ix, iy, iz )

    def ValueAt( self, ix, iy, iz ):
        return self.Values[ix][iy][iz]

    def PointAt( self, ix, iy, iz ):
        nx, ny, nz = self.Count
        tx = ix / ( nx - 1 )
        ty = iy / ( ny - 1 )
        tz = iz / ( nz - 1 )
        return Point3d(
            self.Min.X * ( 1 - tx ) + self.Max.X * tx,
            self.Min.Y * ( 1 - ty ) + self.Max.Y * ty,
            self.Min.Z * ( 1 - tz ) + self.Max.Z * tz )

    def Points( self ):
        for ix, iy, iz in self.PointIndices( ):
            yield self.PointAt( ix, iy, iz )

    def VoxelIndices( self ):
        nx, ny, nz = self.Count
        for ix in range( nx - 1 ):
            for iy in range( ny - 1 ):
                for iz in range( nz - 1 ):
                    yield ( ix, iy, iz )

    def VoxelBoxAt( self, ix, iy, iz ):
        return BoundingBox(
            self.PointAt( ix + 0, iy + 0, iz + 0 ),
            self.PointAt( ix + 1, iy + 1, iz + 1 ) )

    Vertices = [
        [0, 0, 0], [1, 0, 0], [1, 1, 0], [0, 1, 0],
        [0, 0, 1], [1, 0, 1], [1, 1, 1], [0, 1, 1]]

    def VoxelAt( self, ix, iy, iz ):
        return [self.PointAt( ix + dx, iy + dy, iz + dz )
            for dx, dy, dz in VoxelGrid.Vertices]

    def Voxels( self ):
        for ix, iy, iz in self.VoxelIndices( ):
            yield self.VoxelAt( ix, iy, iz )

    def VoxelBoxAt( self, ix, iy, iz ):
        return BoundingBox(
            self.PointAt( ix + 0, iy + 0, iz + 0 ),
            self.PointAt( ix + 1, iy + 1, iz + 1 ) )

    def VoxelBoxes( self ):
        for ix, iy, iz in self.VoxelIndices( ):
            yield self.VoxelBoxAt( ix, iy, iz )

    def TetrahedronPointsAt( self, ix, iy, iz, index ):
        offsets = self.TetrahedronOffsetsAt( ix, iy, iz, index )
        return [self.PointAt( ix + dx, iy + dy, iz + dz )
                    for dx, dy, dz in offsets]

    def TetrahedronValuesAt( self, ix, iy, iz, index ):
        offsets = self.TetrahedronOffsetsAt( ix, iy, iz, index )
        return [self.Values[ix + dx][iy + dy][iz + dz]
                    for dx, dy, dz in offsets]

    def TetrahedronPointsAndValuesAt( self, ix, iy, iz, index ):
        offsets = self.TetrahedronOffsetsAt( ix, iy, iz, index )
        points, values = [], []
        for dx, dy, dz in offsets:
            points.append( self.PointAt( ix + dx, iy + dy, iz + dz ) )
            values.append( self.Values[ix + dx][iy + dy][iz + dz] )
        return ( points, values )

    Tetras = [
        [[0, 2, 5, 7], [0, 4, 5, 7], [0, 2, 3, 7], [2, 5, 6, 7], [0, 1, 2, 5]],
        [[0, 1, 3, 4], [1, 4, 5, 6], [3, 4, 6, 7], [1, 2, 3, 6], [1, 3, 4, 6]]]

    def TetrahedraAt( self, ix, iy, iz ):
        for index in range( len( VoxelGrid.Tetras[0] ) ):
            yield self.TetrahedronPointsAndValuesAt( ix, iy, iz, index )

    def TetrahedronOffsetsAt( self, ix, iy, iz, index ):
        tetrahedron = self.TetrahedronAt( ix, iy, iz, index )
        return [VoxelGrid.Vertices[vertex]
                    for vertex in tetrahedron]

    def TetrahedronAt( self, ix, iy, iz, index ):
        tetrahedra = self.ReflectionAt( ix, iy, iz )
        return tetrahedra[index]

    def ReflectionAt( self, ix, iy, iz ):
        parity = ( ix ^ iy ^ iz ) & 1
        return VoxelGrid.Tetras[parity]

    TetraFaces = [[0, 1, 2],
                  [1, 2, 3],
                  [2, 0, 3],
                  [0, 1, 3]]

    def TetrahedronMeshAt( self, ix, iy, iz, index ):
        mesh = Mesh( )
        for vertex in self.TetrahedronPointsAt( ix, iy, iz, index ):
            mesh.Vertices.Add( vertex )
        for a, b, c in VoxelGrid.TetraFaces:
            mesh.Faces.AddFace( a, b, c )
        return mesh

    def VoxelTetrahedraMeshesAt( self, ix, iy, iz ):
        count = len( VoxelGrid.Tetras[0] )
        return [self.TetrahedronMeshAt( ix, iy, iz, index )
            for index in range( count )]

    def InterpolateEdge( self, p, u, q, v, w ):
        t = ( w - u ) / ( v - u )
        return p * ( 1 - t ) + q * t

    Windings = [[0, 0, 0, 0], #  0 -   - 15
                [0, 1, 2, 3], #  1 - T - 14
                [1, 0, 3, 2], #  2 - T - 13
                [0, 1, 2, 3], #  3 - Q - 12

                [2, 3, 0, 1], #  4 - T - 11
                [3, 1, 2, 0], #  5 - Q - 10
                [2, 1, 3, 0], #  6 - Q - 9
                [3, 0, 1, 2], #  7 - T - 8

                [3, 2, 1, 0], #  8 - T - 7
                [1, 2, 3, 0], #  9 - Q - 6
                [0, 2, 1, 3], # 10 - Q - 5
                [2, 1, 0, 3], # 11 - T - 4

                [3, 2, 1, 0], # 12 - Q - 3
                [1, 2, 3, 0], # 13 - T - 2
                [0, 3, 2, 1], # 14 - T - 1
                [0, 0, 0, 0]] # 15 -   - 0

    Polygons = [0, 0, 0, 1,
                0, 1, 1, 0,
                0, 1, 1, 0,
                1, 0, 0, 0]

    def IsoSurfaceAt( self, value ):
        vertex_cache = {}
        mesh = Mesh( )
        for ix, iy, iz in self.VoxelIndices( ):
            for points, values in self.TetrahedraAt( ix, iy, iz ):
                case = self.Scenario( points, values, value )
                if( case == 0 or case == 15 ): continue
                self.AddFace( mesh, case, points, values, value, vertex_cache )
        mesh.Faces.ConvertQuadsToTriangles()
        return mesh

    def get_vertex_index(self, mesh, pt, vertex_cache, tol=1e-6):
        key = (round(pt.X, 6), round(pt.Y, 6), round(pt.Z, 6))
            
        if key in vertex_cache:
            return vertex_cache[key]
        
        idx = mesh.Vertices.Add(pt)
        vertex_cache[key] = idx
        return idx

    def Scenario( self, points, values, value ):
        return ( ( 1 if( values[0] < value ) else 0 ) |
                 ( 2 if( values[1] < value ) else 0 ) |
                 ( 4 if( values[2] < value ) else 0 ) |
                 ( 8 if( values[3] < value ) else 0 ) )

    def AddFace( self, mesh, case, points, values, value, vertex_cache ):
        points, values = self.Permutate( case, points, values )
        if( VoxelGrid.Polygons[case] ):
            return self.AddQuad( mesh, points, values, value, vertex_cache )
        return self.AddTriangle( mesh, points, values, value, vertex_cache )

    def Permutate( self, case, points, values ):
        i, j, k, l = VoxelGrid.Windings[case]
        return ( [points[i], points[j], points[k], points[l]],
                 [values[i], values[j], values[k], values[l]] )

    def AddQuad( self, mesh, points, values, value, vertex_cache ):
        a, b, c, d = points
        A, B, C, D = values

        e = self.InterpolateEdge( d, D, a, A, value )
        f = self.InterpolateEdge( d, D, b, B, value )
        g = self.InterpolateEdge( c, C, b, B, value )
        h = self.InterpolateEdge( c, C, a, A, value )

        i_e = self.get_vertex_index(mesh, e, vertex_cache)
        i_f = self.get_vertex_index(mesh, f, vertex_cache)
        i_g = self.get_vertex_index(mesh, g, vertex_cache)
        i_h = self.get_vertex_index(mesh, h, vertex_cache)

        if len({i_e, i_f, i_g, i_h}) == 4:  # prevent degeneracy
            mesh.Faces.AddFace(i_e, i_f, i_g, i_h)
            
        return self

    def AddTriangle( self, mesh, points, values, value, vertex_cache ):
        a, b, c, d = points
        A, B, C, D = values

        e = self.InterpolateEdge( a, A, b, B, value )
        f = self.InterpolateEdge( a, A, c, C, value )
        g = self.InterpolateEdge( a, A, d, D, value )

        i_e = self.get_vertex_index(mesh, e, vertex_cache)
        i_f = self.get_vertex_index(mesh, f, vertex_cache)
        i_g = self.get_vertex_index(mesh, g, vertex_cache)

        if len({i_e, i_f, i_g}) == 3:  # prevent degeneracy
            mesh.Faces.AddFace(i_e, i_f, i_g)

        return self

    def ImplicitSurface( self, function ):
        for ix, iy, iz in self.PointIndices( ):
            point = self.PointAt( ix, iy, iz )
            self.Values[ix][iy][iz] = function(
                 point.X, point.Y, point.Z )
        return self

    def SignedDistanceField( self, subject ):
        for ix, iy, iz in self.PointIndices( ):
            point = self.PointAt( ix, iy, iz )
            self.Values[ix][iy][iz] = (
                subject.SignedDistance( point ) )

class Sphere:
    def __init__( self, origin, radius ):
        self.Origin = origin
        self.Radius = radius

    def SignedDistance( self, point ):
        o, r = self.Origin, self.Radius
        return o.DistanceTo( point ) - r

class Cylinder:
    def __init__( self, origin, direction, radius ):
        self.Origin    = origin
        self.Direction = direction
        self.Radius    = radius

    def SignedDistance( self, point ):
        o, u, r = self.Origin, self.Direction, self.Radius
        return point.DistanceTo( o + u * ( point - o ) * u ) - r

class Pipe:
    def __init__( self, curve, radius ):
        self.Curve  = curve
        self.Radius = radius

    def SignedDistance( self, point ):
        _, t = self.Curve.ClosestPoint( point )
        projection = self.Curve.PointAt( t )
        return projection.DistanceTo( point ) - self.Radius

class BooleanUnion:
    def __init__( self, subjects ):
        self.Subjects = subjects

    def SignedDistance( self, point ):
        distances = [subject.SignedDistance( point )
            for subject in self.Subjects]
        return min( distances )

class BooleanIntersection:
    def __init__( self, subjects ):
        self.Subjects = subjects

    def SignedDistance( self, point ):
        distances = [subject.SignedDistance( point )
            for subject in self.Subjects]
        return max( distances )

class BooleanDifference:
    def __init__( self, subject, _object ):
        self.Subject = subject
        self.Object  = _object

    def SignedDistance( self, point ):
        subject = self.Subject.SignedDistance( point )
        _object = self.Object .SignedDistance( point )
        return max( subject, -_object )

class Offset:
    def __init__( self, object_, distance ):
        self.Object   = object_
        self.Distance = distance

    def SignedDistance( self, point ):
        distance = self.Object.SignedDistance( point )
        return distance - self.Distance

class Shell:
    def __init__( self, object_, thickness ):
        self.Object    = object_
        self.Thickness = thickness

    def SignedDistance( self, point ):
        distance = self.Object.SignedDistance( point )
        return abs( distance ) - self.Thickness

class Blend:
    def __init__( self, subjects, kappa ):
        self.Subjects = subjects
        self.Kappa    = kappa * 4.0
        self.KappaInv = 1.0 / self.Kappa

    def QuadraticMin( self, a, b ):
        k, i = self.Kappa, self.KappaInv
        h = max( k - abs( a - b ), 0.0 ) * i
        return min( a, b ) - h *  h * k * 0.25

    def SignedDistance( self, point ):
        distances = [subject.SignedDistance( point )
            for subject in self.Subjects]
        minimum = distances[0]
        for distance in distances[1:]:
            minimum = self.QuadraticMin(
                minimum, distance )
        return minimum


bbox = bounding_geometry.GetBoundingBox(True)
Margin = Point3d(margin, margin, margin)

grid = VoxelGrid(
    bbox.Min - Margin,
    bbox.Max + Margin,
    [resolution, resolution, resolution] )

def random_point_in_brep(brep, max_attempts=100):
    bbox = brep.GetBoundingBox(True)
    
    for _ in range(max_attempts):
        x = random.uniform(bbox.Min.X, bbox.Max.X)
        y = random.uniform(bbox.Min.Y, bbox.Max.Y)
        z = random.uniform(bbox.Min.Z, bbox.Max.Z)
        pt = Point3d(x, y, z)
        
        if brep.IsPointInside(pt, 0.01, True):
            return pt
    return None

def populate_brep(brep, count):
    points = []
    for _ in range(count):
        pt = random_point_in_brep(bounding_geometry)
        if pt:
            points.append(pt)
    return points

points = populate_brep(bounding_geometry, count)
curve = Curve.CreateInterpolatedCurve(points, 3)

grid.SignedDistanceField(
    Pipe( curve, radius ) )

surface = grid.IsoSurfaceAt( 0.0 )
surface.Vertices.CombineIdentical(True, True)
surface.Faces.CullDegenerateFaces()
surface.Vertices.CullUnused()
surface.Weld(0.01)
surface.FillHoles()
surface.UnifyNormals()
surface.Normals.ComputeNormals()

Geometry = [surface]
# ---------- end _3d_lattice_generation ----------

panel_2 = Panel("3D Framework")
wrap = ShrinkWrap(
    Geometry=_3d_lattice_generation.Geometry,
    EdgeLength=Slider(0.5, range=0..1),
    Offset=0,
    Smoothing=0,
    Optimization=10,
    FillHoles=True)  # disabled
tri = Triangulate(Mesh=wrap)  # -> Mesh, Count; disabled

min_noise = Slider(-2.5, range=-10..0)

# ----
# Guide: applying Surface Pattern Perturbation (SPP) to the top surface of solid
# 
# 1. Set [SPP] input [keep edges] to True
# 2. Set [deconstruct brep] input [brep] to chosen solid
# 3. Connect [SPP] in place of [Srf] to transform [top_face], i.e. [deconstruct brep] --> [SPP] --> [reconstruct brep]
brep_2 = Brep(<brep referenced from the Rhino model>)
deconstruct_brep = Python3Script(brep=brep_2)  # -> top_face, side_faces; inputs brep: Brep; disabled
# ---------- deconstruct_brep: Python ----------
import Rhino.Geometry as rg
import random

top_face = None
side_faces = []

max_z = -1e9

for face in brep.Faces:
    u_domain = face.Domain(0)
    v_domain = face.Domain(1)
    u_mid = (u_domain.T0 + u_domain.T1) / 2
    v_mid = (v_domain.T0 + v_domain.T1) / 2
    
    pt = face.PointAt(u_mid, v_mid)
    
    if pt.Z > max_z:
        max_z = pt.Z
        top_face = face

# collect all other faces
for face in brep.Faces:
    if face != top_face:
        side_faces.append(face.DuplicateFace(False))
# ---------- end deconstruct_brep ----------
srf = Surface(deconstruct_brep.top_face)
reconstruct_brep = Python3Script(top_face=srf, side_faces=deconstruct_brep.side_faces)  # -> out, brep; inputs top_face: Surface, side_faces: list of Surface; disabled
# ---------- reconstruct_brep: Python ----------
from Rhino.Geometry import Brep 

top_brep = top_face.ToBrep()
side_breps = [face.ToBrep() for face in side_faces]

all_faces = side_breps + [top_brep]

joined = Brep.JoinBreps(all_faces, 0.01)

if joined and len(joined) == 1 and joined[0].IsSolid:
    brep = joined[0]
# ---------- end reconstruct_brep ----------

wall_thickness = Slider(0.5, range=0..2)

point_sampling_density = Slider(100, range=0..200)
random_seed_2 = Slider(0.9, range=0..1)
srf_2 = Surface(<surface referenced from the Rhino model>)
network_height = Slider(5, range=0..20)
continuous_network_structures = ContinuousNetworkStructures(surface=srf_2, count=point_sampling_density, height=network_height, thickness=wall_thickness, seed=random_seed_2)  # disabled

object_type_set = ValueList({"Circle", "Square", "Triangle", "Custom"}, selected=["Circle", "Square", "Triangle"])
square = Slider(0.2, range=0..1)
custom = Slider(0.256, range=0..1)
circle = Slider(0.6, range=0..1)
triangle = Slider(0.2, range=0..1)
relative_abundance = Merge(Data1=circle, Data2=square, Data3=triangle, Data4=custom)
spatial_arrangement = ValueList({"Random", "Uniform", "Clumped"}, selected="Random")
object_density = Slider(0.04, range=0.01..0.5)
min_size = Slider(2, range=0.1..10)
max_size = Slider(4, range=0.1..10)
min_height = Slider(2, range=-20..20)
max_height = Slider(10, range=-20..20)
allow_overlap = BooleanToggle(False)
random_seed_3 = Slider(5, range=0..10)
srf_3 = Surface(<surface referenced from the Rhino model>)
curve = Curve(<curve referenced from the Rhino model>)
discrete_extruded_structures = Python3Script(
    surface=srf_3,
    custom_shape=curve,
    shape_types=object_type_set,
    relative_abundance=relative_abundance,
    dist_type=spatial_arrangement,
    density=object_density,
    min_size=min_size,
    max_size=max_size,
    min_height=min_height,
    max_height=max_height,
    overlap=allow_overlap,
    seed=random_seed_3)  # -> out, breps; inputs surface: Surface, custom_shape: Curve, shape_types: list, relative_abundance: list of Double, density: Double, min_size: Double, max_size: Double; disabled
# ---------- discrete_extruded_structures: Python ----------
# requirements: numpy

import math
import random

import numpy as np

import Rhino
from Rhino.Geometry import (Circle, Point3d, Polyline, 
        Curve, Intersect, Vector3d, Ray3d, Plane, 
        NurbsCurve, LoftType, Brep, Transform)

random.seed(seed)
tol = Rhino.RhinoDoc.ActiveDoc.ModelAbsoluteTolerance
Z = Vector3d.ZAxis
breps = []

srf_bbox = surface.GetBoundingBox(True)
xmin, ymin = srf_bbox.Min.X, srf_bbox.Min.Y
xmax, ymax = srf_bbox.Max.X, srf_bbox.Max.Y
srf_width = xmax - xmin
srf_height = ymax - ymin

# -----------------------------
# Discrete Structure Class
# -----------------------------
class DiscreteStructure():

    def __init__(self, point, shape, size, height):
        self.point = point
        self.shape = shape
        self.size = size
        self.height = height
        self.curve = make_shape(shape, point, size)

    def get_radius(self):
        """ Radius for collision: half of max extent."""
        if self.shape == "Circle":
            return self.size / 2
        elif self.shape == "Square":
            return (self.size * math.sqrt(2)) / 2
        elif self.shape == "Triangle":
            return self.size / math.sqrt(3)
        elif self.shape == "Custom":
            bbox = self.curve.GetBoundingBox(True)
            diag = bbox.Diagonal
            return math.sqrt(diag.X**2 + diag.Y**2) / 2

    def shift(self, dx, dy, dz):
        self.point.X += dx
        self.point.Y += dy
        self.point.Z += dz
        self.curve.Translate(Vector3d(dx, dy, dz))

    def recalibrate_point(self):
        pt = Point3d(self.point.X, self.point.Y, srf_bbox.Max.Z + 10)
        rc = project_point_vertical(surface, pt)
        if rc:
            delta = rc - self.point
            self.shift(delta.X, delta.Y, delta.Z)
            return True
        return False


# -----------------------------
# Utility functions
# -----------------------------
def project_point_vertical(surface, point):
    rc = Intersect.Intersection.RayShoot([surface], Ray3d(point, -Z), 1)
    if not rc:
        rc = Intersect.Intersection.RayShoot([surface], Ray3d(point, Z), 1)
    if rc:
        return(rc[0].Point)


def project_curve_vertical(surface, curve, samples=40):
    pts = []
    for i in range(samples):
        t = curve.Domain.ParameterAt(i / (samples-1))
        p = curve.PointAt(t)

        rc = project_point_vertical(surface, p)
        if rc:
            pts.append(rc)
        else:
            return
    if len(pts) >= 2:
        return NurbsCurve.Create(False, 3, pts)


def make_shape(shape, center, size):
    if shape == "Circle":
        c = Circle(Plane.WorldXY, size*0.5)
        curve = c.ToNurbsCurve()

    elif shape == "Square":
        pts = [
            Point3d(-size/2,-size/2,0),
            Point3d(size/2,-size/2,0),
            Point3d(size/2,size/2,0),
            Point3d(-size/2,size/2,0),
            Point3d(-size/2,-size/2,0)
        ]
        poly = Polyline(pts)
        curve = poly.ToNurbsCurve()

    elif shape == "Triangle":
        # equilateral triangle, size = side length
        h = size * math.sqrt(3) / 2  # height of equilateral triangle
        pts = [
            Point3d(-size/2, -h/3, 0),
            Point3d(size/2, -h/3, 0),
            Point3d(0, 2*h/3, 0),
            Point3d(-size/2, -h/3, 0)
        ]
        curve = Polyline(pts).ToNurbsCurve()

    elif shape == "Custom":
        curve = custom_shape.Duplicate()
        bbox = curve.GetBoundingBox(True)
        current_size = max(bbox.Diagonal.X, bbox.Diagonal.Y)

        if current_size > 0:
            scale = size / current_size
            xform = Transform.Scale(Plane.WorldXY, scale, scale, 1)
            curve.Transform(xform)

        bbox = curve.GetBoundingBox(True)
        curve_center = bbox.Center
        curve.Translate(center - curve_center)
        return curve

    curve.Translate(center - Plane.WorldXY.Origin)
    return curve


def generate_points(dist_type, num, ud, vd, num_clusters=3, cluster_radius = 3 * max_size):
    points = []

    if dist_type == "Random":
        for _ in range(num):
            u = random.uniform(ud.T0, ud.T1)
            v = random.uniform(vd.T0, vd.T1)
            pt = surface.PointAt(u,v)
            points.append(pt)

    elif dist_type == "Uniform":        
        # compute approximate grid size
        n_cols = int(math.sqrt(pop_size * srf_width / srf_height))
        n_rows = int(math.ceil(pop_size / n_cols))
        dx = srf_width / n_cols
        dy = srf_height / n_rows
                
        for i in range(n_rows):
            for j in range(n_cols):
                x = xmin + (j + 0.5) * dx
                y = ymin + (i + 0.5) * dy
                pt = Point3d(x, y, srf_bbox.Max.Z + 10)
                
                # project onto surface
                rc = project_point_vertical(surface, pt)
                if rc:
                    points.append(rc)

    elif dist_type == "Clumped":
        n_cols = math.ceil(math.sqrt(num_clusters * srf_width / srf_height))
        n_rows = math.ceil(num_clusters / n_cols)
        dx = srf_width / n_cols
        dy = srf_height / n_rows

        cluster_centers_xy = []
        jitter = 0.4  # fraction of cell size

        # generate evenly spaced cluster centers
        for i in range(n_rows):
            for j in range(n_cols):
                cx = xmin + (j + 0.5 + random.uniform(-jitter, jitter)) * dx
                cy = ymin + (i + 0.5 + random.uniform(-jitter, jitter)) * dy
                cluster_centers_xy.append((cx, cy))
                if len(cluster_centers_xy) >= num_clusters:
                    break

        # generate points around centers
        for i in range(num):
            cx, cy = random.choice(cluster_centers_xy)
            x = random.gauss(cx, cluster_radius)
            y = random.gauss(cy, cluster_radius)
            pt = Point3d(x, y, srf_bbox.Max.Z + 10)
            rc = project_point_vertical(surface, pt)
            if rc:
                points.append(rc)

    return points


def resolve_collisions(structures, iterations=50, strength=0.7):
    hx = srf_width / 2
    hy = srf_height / 2
    cx = (xmin + xmax) / 2
    cy = (ymin + ymax) / 2
    X, Y, R = 0, 1, 2

    count = len(structures)

    for _ in range(iterations):
        for i in range(count):
            for j in range(i + 1, count):
                dx = structures[j].point.X - structures[i].point.X
                dy = structures[j].point.Y - structures[i].point.Y

                dist_sq = dx*dx + dy*dy
                min_dist = structures[i].get_radius() + structures[j].get_radius()

                if dist_sq < min_dist * min_dist:
                    dist = math.sqrt(dist_sq)

                    if dist < 1e-6:
                        dx, dy = random.random(), random.random()
                        dist = math.hypot(dx, dy)

                    overlap = min_dist - dist
                    factor = 0.5 * strength * overlap / dist

                    fx = factor * dx
                    fy = factor * dy

                    structures[i].shift(-fx, -fy, 0)
                    structures[j].shift(fx, fy, 0)

        # clamp inside surface bbox
        for s in structures:
            r = s.get_radius()
            x = np.clip(s.point.X, xmin + r, xmax - r)
            y = np.clip(s.point.Y, ymin + r, ymax - r)
            dx, dy = x - s.point.X, y - s.point.Y
            s.shift(dx, dy, 0)

    for s in structures:
        s.recalibrate_point()

    return structures


# -----------------------------
# Make discrete structures
# -----------------------------

ud = surface.Domain(0)
vd = surface.Domain(1)
xyArea = srf_width * srf_height
pop_size = int(density * xyArea)
points = generate_points(dist_type, pop_size, ud, vd, num_clusters=3, cluster_radius=max_size)

total_weight = sum(relative_abundance)
relative_abundance = [w / total_weight for w in relative_abundance]

structures = []
for point in points:
    shape = random.choices(shape_types, relative_abundance)[0]
    size = random.uniform(min_size, max_size)
    height = random.uniform(min_height, max_height)
    ds = DiscreteStructure(point, shape, size, height)
    structures.append(ds)
    
if not overlap and dist_type != "Uniform":
    structures = resolve_collisions(structures)

for ds in structures:
    curve = ds.curve

    top_curve = curve.Duplicate()
    top_curve.Translate(Z * ds.height)

    base_curve = project_curve_vertical(surface, top_curve)
    if not base_curve or not base_curve.IsClosed:
        continue

    loft = Brep.CreateFromLoft(
        [base_curve, top_curve],
        Point3d.Unset,
        Point3d.Unset,
        LoftType.Straight,
        False
    )

    if loft:
        brep = loft[0].CapPlanarHoles(tol)
        breps.append(brep)

breps.append(surface.ToBrep())
# ---------- end discrete_extruded_structures ----------

keep_edges = BooleanToggle(True)

srf_4 = Surface(<surface referenced from the Rhino model>)
grid_resolution = Slider(30, range=1..50)
max_noise = Slider(5, range=0..10)
noise_probability = Slider(1, range=0..1)
random_seed_4 = Slider(5, range=0..10)
surface_pattern_perturbation = Python3Script(
    surface=srf_4,
    resolution=grid_resolution,
    min_noise=min_noise,
    max_noise=max_noise,
    p_noise=noise_probability,
    keep_edges=keep_edges,
    seed=random_seed_4)  # -> messages, surface; inputs surface: Surface, resolution: Int32; disabled
# ---------- surface_pattern_perturbation: Python ----------
import Rhino.Geometry as rg
import random

random.seed(seed)

nx = resolution
ny = resolution

points = []
# Get surface domains
u_domain = surface.Domain(0)
v_domain = surface.Domain(1)

margin = resolution / 30

for i in range(nx):
    for j in range(ny):
        u = u_domain.T0 + (u_domain.T1 - u_domain.T0) * i/(nx-1)
        v = v_domain.T0 + (v_domain.T1 - v_domain.T0) * j/(ny-1)
        p = surface.PointAt(u, v)

        ignore_edge = keep_edges and ( i in (0, nx - 1) or j in (0, ny - 1) )

        if not ignore_edge and random.random() < p_noise:
            dz = random.uniform(min_noise, max_noise)
            p = rg.Point3d(p.X, p.Y, p.Z + dz)

        points.append(p)

surface = rg.NurbsSurface.CreateFromPoints(points, nx, ny, 3, 3 )
# ---------- end surface_pattern_perturbation ----------

# ----
# CNS currently only supports planar surfaces
number_slider = Slider(0.5, range=0..1)
wrap_2 = ShrinkWrap(Geometry=continuous_network_structures, EdgeLength=number_slider, Offset=0, Smoothing=0, Optimization=10, FillHoles=True)  # disabled

panel_3 = Panel("Extended 2D Framework")
panel_4 = Panel("Surface Pattern Perturbation")
panel_5 = Panel("Connected Network Structures")
panel_6 = Panel("Discrete Extruded Structures")
triremesh = TriRemesh(Geometry=surface_pattern_perturbation.surface, Length=Slider(0.5, range=0..1), Iterations=25)  # -> Triangulation, Dual, Creases; disabled
triangulate = Triangulate(geometry=discrete_extruded_structures.breps, length=Slider(0.5, range=0..1))  # disabled

panel_7 = Panel(discrete_extruded_structures.out)
tri_2 = Triangulate(Mesh=wrap_2)  # -> Mesh, Count; disabled

panel_8 = Panel("Complexity Metrics")

panel_9 = Panel("3D Rugosity")
panel_10 = Panel("Fractal Dimension")

mesh = Mesh(<mesh referenced from the Rhino model>)
rugosity = Python3Script(mesh=mesh, voxel_size=Slider(10.1, range=0.1..50))  # -> out, global_rugosity, vertex_values; inputs mesh: Mesh; disabled
# ---------- rugosity: Python ----------
# requirements: shapely
# requirements: trimesh
# requirements: numpy


import Rhino.Geometry as rg
import trimesh
import numpy as np
from shapely.geometry import Polygon
from shapely.ops import unary_union
from collections import defaultdict
from trimesh.transformations import translation_matrix

tmesh = trimesh.Trimesh( 
    [[p.X, p.Y, p.Z] for p in mesh.Vertices],
    [[p.A, p.B, p.C] for p in mesh.Faces] )

def mesh_faces_to_grid(mesh, cell_size):
    """
    Assign mesh faces to a 3D voxel grid.

    Parameters
    ----------
    mesh : trimesh.Trimesh
    cell_size : float

    Returns
    -------
    grid : dict
        {(i,j,k): [face_indices]}
    bbox_min : (3,) array
        grid origin
    grid_shape : (3,) array
        number of cells in each dimension
    """

    # mesh bounds
    bbox_min = mesh.vertices.min(axis=0)
    bbox_max = mesh.vertices.max(axis=0)

    grid_shape = np.ceil((bbox_max - bbox_min) / cell_size).astype(int)

    triangles = mesh.triangles  # (F,3,3)

    # triangle bounding boxes
    tri_min = triangles.min(axis=1)
    tri_max = triangles.max(axis=1)

    # convert to grid coordinates
    grid_min = np.floor((tri_min - bbox_min) / cell_size).astype(int)
    grid_max = np.floor((tri_max - bbox_min) / cell_size).astype(int)

    grid = defaultdict(list)

    for f in range(len(triangles)):
        gmin = grid_min[f]
        gmax = grid_max[f]

        for i in range(gmin[0], gmax[0] + 1):
            for j in range(gmin[1], gmax[1] + 1):
                for k in range(gmin[2], gmax[2] + 1):
                    grid[(i, j, k)].append(f)

    return grid, (bbox_min, bbox_max), grid_shape


def voxel_index_to_box(voxel_index, bbox_min, bbox_max, grid_shape):
    """
    Create a trimesh box for a voxel given its index in the grid.
    
    Parameters
    ----------
    voxel_index : tuple of 3 ints
        (i, j, k) voxel index in the grid
    bbox_min : array-like, shape (3,)
        Minimum coordinates of the bounding box
    bbox_max : array-like, shape (3,)
        Maximum coordinates of the bounding box
    grid_shape : tuple of 3 ints
        Number of cells along each axis (nx, ny, nz)
        
    Returns
    -------
    box : trimesh.Trimesh
        A box mesh representing the voxel
    """
    
    voxel_index = np.array(voxel_index)
    bbox_min = np.array(bbox_min)
    bbox_max = np.array(bbox_max)
    grid_shape = np.array(grid_shape)
    
    # compute cell size in each dimension
    cell_size = (bbox_max - bbox_min) / grid_shape
    
    # compute voxel center
    center = bbox_min + (voxel_index + 0.5) * cell_size
    
    # create box
    box = trimesh.creation.box(
        extents=cell_size,
        transform=translation_matrix(center)
    )
    
    return box

geometry = []
grid, bounds, shape = mesh_faces_to_grid( tmesh, voxel_size )

O = bounds[0]
D = bounds[1] - bounds[0]

def triangle_area(a, b, c):
    return 0.5 * np.linalg.norm(np.cross(b - a, c - a))

def project_to_plane(points, origin, normal):
    normal = normal / np.linalg.norm(normal)
    dist = np.dot(points - origin, normal)
    return points - np.outer(dist, normal)

def plane_basis(normal):
    normal = normal / np.linalg.norm(normal)

    if abs(normal[0]) < 0.9:
        t = np.array([1,0,0])
    else:
        t = np.array([0,1,0])

    u = np.cross(normal, t)
    u /= np.linalg.norm(u)

    v = np.cross(normal, u)

    return u, v

def to_2d(points, origin, u, v):
    d = points - origin
    x = np.dot(d, u)
    y = np.dot(d, v)
    return np.column_stack((x,y))

rugosity_dict = {}
global_area = 0
global_projected = 0

for cell, faces in grid.items():

    faces_idx = tmesh.faces[faces]
    vertices = tmesh.vertices

    # --- total triangle area ---
    total_area = 0.0
    for f in faces_idx:
        a,b,c = vertices[f]
        total_area += triangle_area(a,b,c)

    # --- find best fit plane ---
    points = vertices[np.unique(faces_idx.flatten())]
    origin = points.mean(axis=0)
    u_pts = points - origin
    eigvals, eigvecs = np.linalg.eigh(u_pts.T @ u_pts)
    normal = eigvecs[:,0]
    u,v = plane_basis(normal)

    projected_triangles = []

    # --- project triangles ---
    for f in faces_idx:
        tri = vertices[f]
        proj = project_to_plane(tri, origin, normal)
        tri2d = to_2d(proj, origin, u, v)
        projected_triangles.append(tri2d)

    # --- compute union area ---

    polys = [Polygon(tri) for tri in projected_triangles]
    union_poly = unary_union(polys)

    projected_area = union_poly.area

    if projected_area > 0:
        rugosity = total_area / projected_area
    else:
        rugosity = 0

    print(cell, rugosity)    
    rugosity_dict[cell] = rugosity
    global_area += total_area
    global_projected += projected_area

global_rugosity = global_area / global_projected
face_values = np.zeros(len(tmesh.faces))  # length matches tmesh
for cell, faces in grid.items():
    face_values[faces] = rugosity_dict[cell]

vertex_values = np.zeros(len(tmesh.vertices))  # one value per vertex
vertex_counts = np.zeros(len(tmesh.vertices))  # to track how many faces contribute

for face_idx, face in enumerate(tmesh.faces):
    for v in face:  # loop over the 3 vertices of this face
        vertex_values[v] += face_values[face_idx]  # add face rugosity
        vertex_counts[v] += 1                      # increment count

# avoid division by zero
vertex_values /= np.maximum(vertex_counts, 1)
# ---------- end rugosity ----------
colorcode = Python3Script(mesh=mesh, values=rugosity.vertex_values, minimum=Slider(1, range=1..3), maximum=Slider(6, range=1..50))  # -> out, geometry; inputs mesh: Mesh; disabled
# ---------- colorcode: Python ----------
# requirements: matplotlib
# requirements: numpy
# requirements: trimesh

import Rhino.Geometry as rg, numpy as np, trimesh
from System.Drawing import Color
import matplotlib.pyplot as plt

def RhinoToLists( mesh, ftype=np.float32, itype=np.int32 ):
    points = np.zeros( ( mesh.Vertices.Count, 3 ), dtype=ftype )
    for index, vertex in enumerate( mesh.Vertices ):
        points[index,:] = [vertex.X, vertex.Y, vertex.Z]

    planes = np.zeros( ( mesh.Faces.Count, 3 ), dtype=itype )
    for index, face in enumerate( mesh.Faces ):
        planes[index,:] = [face.A, face.B, face.C]

    return points, planes

def RhinoToTrimesh( mesh ):
    points, planes = RhinoToLists( mesh )
    return trimesh.Trimesh( points, planes )

def ToRhino( points, planes, colors = None ):    
    mesh = rg.Mesh( )    
    for p in points: mesh.Vertices.Add( *p )
    for p in planes: mesh.Faces.AddFace( *p.tolist( ) )

    if( colors is not None ):        
        for c in colors:
            r, g, b, a = c.tolist( )
            mesh.VertexColors.Add( Color.FromArgb(255, r, g, b) )
    return mesh

def ColorCode( values : np.ndarray, vmin = None, vmax = None, palette = 'jet' ):
    cmap = plt.get_cmap( palette )
    if( vmin is None ): vmin = np.min( values )
    if( vmax is None ): vmax = np.max( values )
    v = np.clip( ( values - vmin ) / ( vmax - vmin ), 0, 1 )
    return ( cmap( v ) * 255 ).astype( np.uint8 ) 

print( f'Min {np.min( values ):.3f} Max {np.max( values ):.3f}' )
mesh = RhinoToTrimesh( mesh )
geometry = ToRhino( mesh.vertices, mesh.faces, 
    ColorCode( values, minimum, maximum ) )

c, v = np.histogram( values, range=(np.min( values ),np.max( values )) )
for index in range( len( v ) - 1 ):
    print( f'{v[index]:.3f}-{v[index+1]:.3f} -> {c[index]}' )
# ---------- end colorcode ----------
panel_11 = Panel(rugosity.global_rugosity)
panel_12 = Panel(colorcode.out)
panel_13 = Panel(rugosity.out)

mesh_2 = Mesh(<mesh referenced from the Rhino model>)
fractal_dim = Python3Script(
    mesh=mesh_2,
    scaling_factor=Slider(2, range=0..10),
    max_scale_coef=Slider(0.25, range=0..1),
    min_scale=Slider(0.1, range=0..10),
    resolution=Slider(0.05, range=0..0.5))  # -> messages, geometry, counts, fractal_dim; inputs mesh: Mesh, min_scale: Double; disabled
# ---------- fractal_dim: Python ----------
# requirements: numpy
# requirements: trimesh

import numpy as np
import trimesh
import time
import random
import Rhino.Geometry as rg
geometry = []

random.seed(42)

# -----------------------------
# Convert Rhino mesh to Trimesh
# -----------------------------
def RhinoToLists(mesh, ftype=np.float32, itype=np.int32):
    points = np.zeros((mesh.Vertices.Count, 3), dtype=ftype)
    for idx, v in enumerate(mesh.Vertices):
        points[idx, :] = [v.X, v.Y, v.Z]

    faces = np.zeros((mesh.Faces.Count, 3), dtype=itype)
    for idx, f in enumerate(mesh.Faces):
        faces[idx, :] = [f.A, f.B, f.C]

    return points, faces

def RhinoToTrimesh(mesh):
    points, faces = RhinoToLists(mesh)
    return trimesh.Trimesh(points, faces)

m = RhinoToTrimesh(mesh)

# -----------------------------
# Box-counting function with random offsets
# -----------------------------
def count_boxes_random(voxel_matrix, k, trials=10):
    sx, sy, sz = voxel_matrix.shape
    counts = []
    
    for _ in range(trials):
        # get random grid offsets
        ox = random.randint(0, k - 1)
        oy = random.randint(0, k - 1)
        oz = random.randint(0, k - 1)
        
        # compute padding
        pad_x_left = k - ox
        pad_y_left = k - oy
        pad_z_left = k - oz
        
        pad_x_right = k - ((sx + pad_x_left) % k)
        pad_y_right = k - ((sy + pad_y_left) % k)
        pad_z_right = k - ((sz + pad_z_left) % k)
        
        # apply padding
        padded = np.pad(voxel_matrix,
                     ((pad_x_left, pad_x_right),
                      (pad_y_left, pad_y_right),
                      (pad_z_left, pad_z_right)),
                     mode='constant',
                     constant_values=0)
        
        # reshape into blocks
        sx2, sy2, sz2 = padded.shape
        reshaped = padded.reshape(sx2//k, k,
                          sy2//k, k,
                          sz2//k, k)
        
        pooled = reshaped.max(axis=(1,3,5))
        counts.append(np.sum(pooled))
    
    return np.mean(counts)

# -----------------------------
# Fractal dimension calculation
# -----------------------------
t0 = time.time()

# Largest scale: cube that fits in the bounding box
bbox = m.bounds  # (min corner, max corner)
bbox_sizes = bbox[1] - bbox[0]
largest_scale = np.max(bbox_sizes)
if max_scale_coef:
    largest_scale = largest_scale * max_scale_coef

# Generate scales: halve each time until min_scale

max_k = int(largest_scale / resolution)

k_values = []
k = max_k
while k >= 1:
    k_values.append(k)
    k = int(k / scaling_factor)

k_values = np.unique(k_values)
scales = k_values * resolution

mask = scales >= min_scale
scales = scales[mask]
k_values = k_values[mask]

# Voxelize at given resolution
voxels = m.voxelized(resolution)
voxel_matrix = voxels.matrix

'''
# get unique scales
k_values = np.array([max(1, int(round(scale / resolution))) for scale in scales])
unique_k, unique_indices = np.unique(k_values, return_index=True)

order = np.argsort(unique_indices)
unique_k = unique_k[order]
unique_indices = unique_indices[order]

scales = scales[unique_indices]
k_values = unique_k

min_k = int(np.ceil(min_scale / resolution))
mask = k_values >= min_k

k_values = k_values[mask]
scales = k_values * resolution
'''

# Count boxes at each scale using random offsets
counts = np.array([count_boxes_random(voxel_matrix, k, trials=10)
                   for k in k_values])

# Only keep scales with >1 box
mask = counts > 1
scales = scales[mask]
counts = counts[mask]

# Log-log regression for fractal dimension
log_e = np.log(1 / scales)          # log(1/box_size)
log_c = np.log(counts)              # log(N)

fractal_dim, intercept = np.polyfit(log_e, log_c, 1)

# Store geometry for plotting (optional)
points = [rg.Point3d(e, c, 0) for e, c in zip(log_e, log_c)]
geometry.extend(points)

def f(x):
    y = fractal_dim * x + intercept 
    return y

line_pts = [rg.Point3d(x, f(x), 0) for x in log_e]
geometry.append(rg.Polyline(line_pts))

t_elapsed = time.time() - t0
print(f'Fractal dimension: {fractal_dim:.4f}')
print(f'Elapsed time: {t_elapsed:.3f} sec')
print(f'Scales used: {scales}')

from sklearn.metrics import r2_score
x_values = log_e
y_values = log_c
predict = np.poly1d([fractal_dim, intercept])
predicted_y_values = predict(x_values)
R2 = r2_score(y_values, predicted_y_values)
print(f"R-squared value: {R2}")

# -----------------------------
# Finding min cutoff
# -----------------------------

def get_min_cutoff():
    s_values = []
    r_values = []

    n = len(log_e)

    for i in range(n - 2):  # need at least 2 points to fit
        x = log_e[i:]
        y = log_c[i:]
        
        slope, intercept = np.polyfit(x, y, 1)
        y_fit = slope * x + intercept
        
        residuals = y - y_fit
        s = np.std(residuals)
        
        s_values.append(s)
        r_values.append(scales[i])  # corresponding scale

    s_values = np.array(s_values)
    r_values = np.array(r_values)

    ds_dr = np.gradient(s_values, r_values)

    line_pts = [rg.Point3d(r, ds_dr, 0) for (r, ds_dr) in zip(r_values, ds_dr)]
    geometry.append(rg.Polyline(line_pts))

    # absolute derivative (flat region)
    threshold = 1e-3  # tune this depending on noise
    candidates = np.where(np.abs(ds_dr) < threshold)[0]

    if len(candidates) > 0:
        cutoff_index = candidates[np.argmin(r_values[candidates])]
    else:
        cutoff_index = np.argmin(np.abs(ds_dr))
        
    r_cutoff = r_values[cutoff_index]

    print(f"Detected min_cutoff based on ds/dr: {r_cutoff}")

# get_min_cutoff()
# ---------- end fractal_dim ----------
panel_14 = Panel(fractal_dim.messages)

# ==== cluster Triangulate
geometry = ClusterInput()
length = ClusterInput()
triremesh = TriRemesh(Geometry=geometry, Sharp=Toggle(False), Length=length, Iterations=25)  # -> Triangulation, Dual, Creases
mjoin = MeshJoin(Meshes=triremesh.Triangulation)
M = ClusterOutput(mjoin)

# ==== cluster ContinuousNetworkStructures
seed = ClusterInput()
count = ClusterInput()
height = ClusterInput()
thickness = ClusterInput()
surface = ClusterInput()
populate = Python3Script(surface=surface, height=height, count=count, seed=seed)  # -> out, points; inputs surface: Surface, count: Int32
# ---------- populate: Python ----------
import random

random.seed(seed)

u_domain = surface.Domain(0)
v_domain = surface.Domain(1)

points = []
for i in range(count):
    u = random.uniform(u_domain.T0, u_domain.T1)
    v = random.uniform(v_domain.T0, v_domain.T1)
    
    pt = surface.PointAt(u, v)
    points.append(pt)
# ---------- end populate ----------
delaunay_mesh = DelaunayMesh(Points=populate.points, Plane=PlaneXY(0, 0, 0))
organic_structures = Python3Script(mesh=delaunay_mesh, surface=surface, thickness=thickness, height=height)  # -> out, geometry; inputs mesh: Mesh, surface: Surface
# ---------- organic_structures: Python ----------
# requirements: networkx

import random
import Rhino
import scriptcontext as sc
import networkx as nx
from Rhino.Geometry import (
    Brep, LoftType, NurbsCurve, 
    Point3d, Vector3d, Curve, Plane
)
from collections import deque


random.seed( 17 )
sc.doc = Rhino.RhinoDoc.ActiveDoc  # Switch to Rhino document`
factor = 3
tolerance = Rhino.RhinoDoc.ActiveDoc.ModelAbsoluteTolerance
Z = Vector3d.ZAxis

ud = surface.Domain( 0 )
vd = surface.Domain( 1 )

geometry = []

srfbrep = surface.ToBrep()  
geometry.append(srfbrep)


## Graph helper functions ##

def FaceCenter( mesh, index ):
    face = mesh.Faces[index]
    a, b, c = ( Point3d( mesh.Vertices[face.A] ),
                Point3d( mesh.Vertices[face.B] ),
                Point3d( mesh.Vertices[face.C] ) )
    return ( a + b + c ) / 3

def multi_source_bfs(graph, sources):
    result = nx.Graph( )

    visited = set(sources)
    queue = deque(sources)

    while queue:
        node = queue.popleft()
        for neighbor in graph.neighbors(node):
            if neighbor not in visited:
                result.add_edge( node, neighbor )
                visited.add(neighbor)
                queue.append(neighbor)
    return result

def get_bfs_spanning_tree():
    graph = nx.Graph( )

    for index in range( mesh.Faces.Count ):
        graph.add_node( index )

    for index in range( mesh.TopologyEdges.Count ):
        indices = list( mesh.TopologyEdges.GetConnectedFaces( index ) )
        if( len( indices ) == 2 ): graph.add_edge( *indices )

    sources = [random.randint( 0, mesh.Faces.Count - 1 ) 
        for _ in range( 5 )]
    tree = multi_source_bfs( graph, sources )
    return tree

### Maze ###
def maze(thickness, height):
    curves = []
    tree = get_bfs_spanning_tree()

    for s, t in tree.edges( ):
        S, T = FaceCenter( mesh, s ), FaceCenter( mesh, t )
        curve = Rhino.Geometry.NurbsCurve.Create(False, 1, [S, T])
        curves.append( curve )
    walls = make_walls(curves, thickness, height)
    joints = make_joints(tree.nodes(), thickness, height)
    return walls, joints


def make_walls(curves, thickness, height):
    walls = []

    for curve in curves:
        if curve.GetLength() < tolerance * 10:
            continue
        #create wall footprint
        offset1 = curve.Offset(
            Plane.WorldXY,
            thickness / 2,
            tolerance,
            Rhino.Geometry.CurveOffsetCornerStyle.Sharp
        )

        offset2 = curve.Offset(
            Plane.WorldXY,
            -thickness / 2,
            tolerance,
            Rhino.Geometry.CurveOffsetCornerStyle.Sharp
        )

        if not offset1 or not offset2:
            continue

        c1 = offset1[0]
        c2 = offset2[0]

        loft = Brep.CreateFromLoft(
            [c1, c2],
            Point3d.Unset,
            Point3d.Unset,
            LoftType.Straight,
            False
        )

        if not loft:
            continue

        footprint = loft[0]
        face = footprint.Faces[0]

        if face.NormalAt(0.5, 0.5).Z < 0:
            footprint.Flip()

        # extrude wall footprint up
        wall = Brep.CreateFromOffsetFace(
            footprint.Faces[0],
            height,
            tolerance,
            False,
            True
        )

        if wall:
            walls.append(wall)

    return walls

def make_joints(nodes, thickness, height):
    node_radius = thickness / 2

    joints = []

    for node in nodes:
        l_p = FaceCenter(mesh, node)
        u_p = l_p + Z * height

        curve = Rhino.Geometry.NurbsCurve.Create(False, 1, [l_p, u_p])

        pipe = Brep.CreatePipe(
            curve,
            node_radius,
            True,
            Rhino.Geometry.PipeCapMode.Flat,
            True,
            tolerance,
            tolerance
        )

        if pipe:
            joints.extend(pipe)
    return joints
    
walls, joints = maze(thickness, height)
geometry.extend(walls)
geometry.extend(joints)
# ---------- end organic_structures ----------
panel = Panel(organic_structures.out)
geometry = ClusterOutput(organic_structures.geometry)
